# Grasshopper definition debugger.gh (Grasshopper 1.0.7)

path = FilePath("/Users/ice5/Desktop/lego-player/debug.csv")
python = GhPythonScript(x=path)  # -> out, box_a, box_b, base_z, base_a, base_b
# ---------- python: Python ----------
__author__ = "ice5"

import rhinoscriptsyntax as rs
import csv

box_a = []
box_b = []
base_z = []
base_a = []
base_b = []
with open(x) as f:
    r = csv.reader(f)
    for idx, row in enumerate(r):
        pt = rs.CreatePoint([float(i) for i in row])
        if idx % 4 == 0:
            box_a.append(pt)
        if idx % 4 == 1:
            box_b.append(pt)
        if idx % 4 == 2:
            base_a.append(pt)
            base_z.append(float(row[2]))
        if idx % 4 == 3:
            base_b.append(pt)
# ---------- end python ----------
Z = UnitZ(Factor=python.base_z)
rec_2pt = Rectangle2Pt(Plane=Z, PointA=python.base_a, PointB=python.base_b, Radius=0)  # -> Rectangle, Length
box = Box2Pt(PointA=python.box_a, PointB=python.box_b, Plane=PlaneXY(0, 0, 0))
item = ListItem(List=rec_2pt.Rectangle, Index=-1, Wrap=True)
panel = Panel(box)
boundary = BoundarySurfaces(Edges=item)
